# Grasshopper definition test1_test2_test3.gh (Grasshopper 1.0.8)
# plug-ins: K2Engineering, LunchBox, Kangaroo2 Components

star_3 = Star3()  # -> struts_2, radial_cables_2, vertical_cables_2
cluster = T3()  # -> struts_2, radial_cables_2, vertical_cables_2
icosahedron = Icosahedron()  # -> struts_2, cables_1, cables_2
radial_cables = Line(cluster.radial_cables_2)
vertical_cables = Line(cluster.vertical_cables_2)
radial_cables_2 = Line(star_3.radial_cables_2)
vertical_cables_2 = Line(star_3.vertical_cables_2)
struts = Line(cluster.struts_2)
struts_2 = Line(star_3.struts_2)
entwine = Entwine(Branch00=icosahedron.struts_2, Branch01=icosahedron.cables_1, Branch02=icosahedron.cables_2, FlattenInputs=True)  # -> simplify(graft(Result))
entwine_2 = Entwine(Branch00=struts_2, Branch01=radial_cables_2, Branch02=vertical_cables_2, FlattenInputs=True)  # -> simplify(graft(Result))
entwine_3 = Entwine(Branch00=struts, Branch01=radial_cables, Branch02=vertical_cables, FlattenInputs=True)  # -> simplify(graft(Result))
seed_pop = Slider(4, range=0..5)

# ---- group: Populate
panel = Panel("20")
negative = Negative(Value=panel)
construct_domain = ConstructDomain(DomainStart=negative, DomainEnd=panel)
rectangle = Rectangle(Plane=PlaneXY(0, 0, 0), XSize=construct_domain, YSize=construct_domain, Radius=0)  # -> Rectangle, Length
height = Panel("4000")
unit_z = UnitZ(Factor="50")
box_rectangle = BoxRectangle(Rectangle=rectangle.Rectangle, Height=height)
nb_of_units = Slider(20, range=1..100)
seed_rot = Slider(3, range=0..3)
move = Move(Geometry=box_rectangle, Motion=unit_z)  # -> Geometry, Transform
populate_3d = Populate3D(Region=move.Geometry, Count=nb_of_units, Seed=seed_pop)
axis = Axis(seed=seed_rot, nb_of_units=nb_of_units)
random = Random(Range="0 To pi", Number=nb_of_units, Seed=seed_rot)
move_2 = Move(Geometry=entwine, Motion=populate_3d)  # -> Geometry, Transform
vector = Vector(axis)
rotate_3d = Rotate3D(Geometry=move_2.Geometry, Angle=random, Center=populate_3d, Axis=vector)  # -> Geometry, Transform
unit_z_2 = UnitZ(Factor=Slider(1, range=0..10))
move_3 = Move(Geometry=rotate_3d.Geometry, Motion=unit_z_2)  # -> Geometry, Transform

# ----
multiple_units = Data(move_3.Geometry)
_1_unit = Data(entwine)
dispatch_elements = DispatchElements(geometry=_1_unit)  # -> struts_2, radial_cables_2, vertical_cables_2

# ---- group: for complex container
range = Range(Domain=Domain(0, 1), Steps=Slider(5, range=0..10))
curve = Curve([dispatch_elements.vertical_cables_2, dispatch_elements.radial_cables_2])
range_2 = Range(Domain=Domain(0, 1), Steps=Slider(20, range=0..20))
shatter = Shatter(Curve=flatten(curve), Parameters=range)
shatter_2 = Shatter(Curve=flatten(dispatch_elements.struts_2), Parameters=range_2)
curve_2 = Curve(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)
curve_3 = Curve(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)
end_points = EndPoints(Curve=[shatter_2, shatter])  # -> Start, End
sweep1 = Sweep1(Rail=curve_3, Sections=curve_2, Miter=1)
cull_duplicates = CullDuplicates(Points=[end_points.Start, end_points.End], Tolerance=0.1, CullMode=3)  # -> flatten(Points), Indices, Valence
cap_holes = CapHoles(Brep=sweep1)
custom_preview = CustomPreview(Geometry=cap_holes, Material=ColourSwatch(SwatchColor=RGBA(179, 140, 191, 51)))
solidpointcollide = SolidPointCollide(
    Points=cull_duplicates.Points,
    Solid=cap_holes,
    Interior=Toggle(True),
    Unidirectional=True,
    Strength=Slider(500, range=0..1000))  # disabled

# ----
end_points_2 = EndPoints(Curve=dispatch_elements.struts_2)  # -> Start, End
cull_duplicates_2 = CullDuplicates(Points=[end_points_2.Start, end_points_2.End], Tolerance=0.1, CullMode=3)  # -> flatten(Points), Indices, Valence
range_3 = Range(Domain=Domain(0, 1), Steps=Slider(5, range=0..10))
list_length = ListLength(List=cull_duplicates_2.Points)
pretension_factor = Slider(0.6, range=0..1)
division = Division(A=Slider(10, range=0..100), B=list_length)
number_slider = Slider(50, range=0..1000)
number_slider_2 = Slider(1, range=0..10)
resize_box = ResizeBox(
    base_rectangle_width=panel,
    factor_width=Slider(3.5, range=1..10),
    base_rectangle_height=height,
    factor_height=Slider(1.2, range=1..3))  # -> box, rectangle_2, final_rectangle_width
strength_vertical_cables = Slider(11.1, range=0..1000)
strength_radial_cables = Slider(11.1, range=0..1000)

# ---- group: Cable to enable to shrink unit
length = Length(Curve=dispatch_elements.radial_cables_2)
multiplication = Multiplication(A=length, B=Slider(0.23, range=0..1))
length_line = LengthLine(Line=dispatch_elements.radial_cables_2, Length=multiplication, Strength=Slider(10, range=0..10))  # disabled

# ----
shatter_3 = Shatter(Curve=dispatch_elements.radial_cables_2, Parameters=range_3)
shatter_4 = Shatter(Curve=dispatch_elements.vertical_cables_2, Parameters=range_3)
unit_z_3 = UnitZ(Factor=division)
length_2 = Length(Curve=shatter_3)
length_3 = Length(Curve=shatter_4)
cables = Line([shatter_3, shatter_4])
number_slider_3 = Slider(0.9, range=0..1)
negative_2 = Negative(Value=unit_z_3)
multiplication_2 = Multiplication(A=length_2, B=pretension_factor)
multiplication_3 = Multiplication(A=length_3, B=pretension_factor)
custom_preview_2 = CustomPreview(Geometry=resize_box.box, Material=ColourSwatch(SwatchColor=RGBA(92, 174, 214, 12)))
collider = Collider(Objects=flatten([dispatch_elements.struts_2, cables]), Radii=number_slider_2, Strength=number_slider)
length_line_2 = LengthLine(Line=dispatch_elements.struts_2, Length=dispatch_elements.struts_2, Strength=Slider(1000, range=0..100000))
solidpointcollide_2 = SolidPointCollide(
    Points=cull_duplicates_2.Points,
    Solid=resize_box.box,
    Interior=Toggle(True),
    Unidirectional=True,
    Strength=number_slider)
length_line_3 = LengthLine(Line=shatter_3, Length=multiplication_2, Strength=strength_radial_cables)
length_line_4 = LengthLine(Line=shatter_4, Length=multiplication_3, Strength=strength_vertical_cables)
load = Load(Point=cull_duplicates_2.Points, ForceVector=negative_2, Weighting=1)
floor = Floor(Strength=number_slider_3)
floorfriction = FloorFriction(Points=cull_duplicates_2.Points, Limit=0.1, Strength=number_slider_3)
merge = Merge(Data1=length_line_2, Data2=length_line_3, Data3=length_line_4)
entwine_4 = Entwine(
    Branch00=merge,
    Branch01=[floor, collider, load, floorfriction, solidpointcollide_2, length_line, solidpointcollide],
    FlattenInputs=True)

# ---- group: Solver (use bouncy for multiple units)
solver = Solver(GoalObjects=entwine_4, Reset=Button(), Threshold="1e-6", Tolerance=0.0001, On=Toggle(False))  # -> I, V, O
bouncysolver = BouncySolver(
    GoalObjects=entwine_4,
    Reset=Button(),
    Threshold="1e-6",
    Tolerance=0.0001,
    Damping=Slider(0.999, range=0.8..1),
    Iterations=Slider(10, range=0..200),
    On=Toggle(False))  # -> I, V, O; disabled

# ----
_30star3 = Data([Line((34.46352168, -4.510452437, 481.8397778), (-70.00825828, 66.41662554, 462.4342065)), Line((-1.10835667, 47.03605569, 225.8482655), (63.03848894, 2.801913081, 124.6034767)), Line((64.03519242, 40.90648929, 455.5759892), (-43.56617956, -1.465433405, 401.2754205)), Line((-29.287125, 4.762263887, 243.7133163), (4.124173057, -70.00583698, 145.6560621)), Line((3.921592898, -70.02252011, 403.3820774), (69.67269809, 22.76017907, 345.1665775)), Line((-0.06033689668, -51.85298188, 167.9874911), (-37.42792872, 67.43915299, 141.6241742))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])
_30star3_2 = Data([Line((-41.69486398, -69.27415522, 276.6546745), (-49.04584412, 12.68893224, 178.9310833)), Line((10.57077136, 21.90865877, 25.36594047), (-69.99557061, -60.38239659, 80.67609929)), Line((24.21900547, -8.36903494, 566.3346442), (43.7407719, 70.00033389, 665.325165)), Line((40.39384494, -6.499292132, 90.99851308), (-57.56465231, 70.01141494, 120.5314005)), Line((15.99940383, 18.39638013, 586.9346853), (-35.44537443, -70.00132201, 510.3780649)), Line((-14.12320672, -16.38729623, -0.01276182395), (69.82962648, 35.55366999, 81.07933487))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])
_30t3 = Data([Line((-38.85947175, 44.42347969, 327.8925352), (45.23146176, -34.96237517, 297.2901771)), Line((-10.6049789, 11.61253561, 15.52519304), (46.25937117, -70.0270315, 81.93919828)), Line((28.41407898, -68.340451, 358.8194775), (-9.391514475, -40.30805256, 468.7959359)), Line((-25.87585522, -68.79060933, 157.9053702), (69.83472845, -9.916896175, 198.9329409)), Line((50.03234502, 2.387275269, 391.1337154), (12.11595254, -68.950233, 302.9112254)), Line((16.02488212, 36.16429233, 103.335215), (70.00621543, 62.95128759, -0.0008576453899))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])
_30t3_2 = Data([Line((4.768615559, -51.14847899, 385.8034789), (-36.74506646, 1.498591691, 286.7341261)), Line((-70.00703712, -70.01018255, 121.6955482), (-38.87575946, 45.16125034, 112.9721894)), Line((70.00131918, -49.77680711, 468.7645637), (8.538887067, 47.41357965, 435.805423)), Line((-8.940685795, 35.94763621, 60.40361646), (46.53600913, -70.01134528, 62.56884634)), Line((-29.14586908, -19.24695235, 413.1743164), (70.01301179, 4.843343807, 350.7484259)), Line((-62.42749169, -37.79443305, 69.1254494), (6.716432311, 59.78190269, 71.93390849))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])
_30t3_final = Data([Line((61.0191077, 20.08571752, 365.5434464), (-41.5773131, -5.455588082, 309.5398958)), Line((-23.64861855, 6.237410504, 74.84019366), (6.65605641, 70.06597266, 171.3940756)), Line((-26.21475158, -40.41644738, 774.3696605), (34.15335998, 0.9225287241, 679.7017044)), Line((-29.29879513, -57.90187898, 91.05860106), (20.1571672, 49.95969601, 106.3981192)), Line((60.8298196, -67.51420187, 538.5569812), (-23.38393138, 17.35846563, 542.8767305)), Line((-51.35708803, 32.07962007, 544.9228664), (54.94537962, 70.06283347, 505.2816085))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])
_30icos_touse = Data(Tree({0;0}: [Line((70.15330864, -19.29575096, 641.1217254), (8.462595622, -65.02325654, 587.8718019)), Line((49.39166769, -70.01429713, 42.19197937), (-25.41965784, -15.41063208, 54.55078922)), Line((2.965883923, 42.38874437, 1158.258662), (34.55683882, 48.68619631, 1245.980257)), Line((38.756194, 5.177356498, 378.5291345), (-24.60871092, -43.44563236, 330.0222358)), Line((-67.99515601, -58.11373224, 773.2581281), (0.6057407378, -64.7189335, 836.3838442)), Line((-28.38726473, 38.95190212, 214.1252758), (-26.19274132, -15.49148445, 138.2101586))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], {0;1}: []))
unflatten_tree = UnflattenTree(Tree=bouncysolver.O, Guide=entwine_4)
explode_tree = ExplodeTree(Data=solver.O)  # -> Branch0, Branch1
unflatten_tree_2 = UnflattenTree(Tree=explode_tree.Branch0, Guide=merge)
dispatch_elements_2 = DispatchElements(geometry=unflatten_tree_2)  # -> struts_2, radial_cables_2, vertical_cables_2

# ---- group: Visualize form-found geometry
relay = Relay([dispatch_elements_2.radial_cables_2, dispatch_elements_2.vertical_cables_2])
pipe = Pipe(Curve=dispatch_elements_2.struts_2, Radius=Slider(0.5, range=0..1), Caps=0)
pipe_2 = Pipe(Curve=relay, Radius=number_slider_2, Caps=0)  # disabled
custom_preview_3 = CustomPreview(Geometry=flatten(relay), Material=ColourSwatch(SwatchColor=RGB(51, 0, 255)))
custom_preview_4 = CustomPreview(Geometry=flatten(dispatch_elements_2.struts_2), Material=ColourSwatch(SwatchColor=RGB(255, 0, 0)))

# ----
boolean_toggle = BooleanToggle(True)
stream_filter = StreamFilter(Gate=boolean_toggle, Stream1=dispatch_elements_2.struts_2)
stream_filter_2 = StreamFilter(Gate=boolean_toggle, Stream1=dispatch_elements_2.radial_cables_2)
stream_filter_3 = StreamFilter(Gate=boolean_toggle, Stream1=dispatch_elements_2.vertical_cables_2)
radial_cables_3 = Curve(flatten(stream_filter_2))
vertical_cables_3 = Curve(flatten(stream_filter_3))
struts_3 = Line(flatten(stream_filter))

# ---- group: Struts and cables
entwine_5 = Entwine(Branch00=multiplication_2, Branch01=multiplication_3, FlattenInputs=True)
entwine_6 = Entwine(Branch00=strength_radial_cables, Branch01=strength_vertical_cables, FlattenInputs=True)
entwine_7 = Entwine(Branch00=radial_cables_3, Branch01=vertical_cables_3, FlattenInputs=True)
length_4 = Length(Curve=entwine_7)
cable_diameter_mm = Slider(4, range=0..10)
strut_diameter_mm = Slider(5, range=0..10)
# 140GPa E modulus of struts
# 5mm diameter, 1mm thickness
materials = Materials(MaterialIndex=Slider(5, range=0..7))  # -> MaterialName, Density, YoungsModulus, ShearModulus, Strength
pretension = Pretension(
    RestLength=expr("x/1000", entwine_5),
    Strength=entwine_6,
    FFLength=expr("x/1000", length_4),
    MaxPretension=Slider(30, range=0.1..50))
e_modulus_struts_mpa = Panel("140000")
e_modulus_cables_mpa = Panel("3.5")
circularcs = CircularCS(Diameter=strut_diameter_mm, Thickness=Slider(1, range=0..1))  # -> A, I, Z, It
circularcs_2 = CircularCS(Diameter=cable_diameter_mm)  # -> A, I, Z, It
explode_tree_2 = ExplodeTree(Data=pretension)  # -> Branch0, Branch1
panel_2 = Panel(materials.MaterialName)
cable = Cable(Line=radial_cables_3, EModulus=e_modulus_cables_mpa, Area=circularcs_2.A, PreTension=explode_tree_2.Branch0)
cable_2 = Cable(Line=vertical_cables_3, EModulus=e_modulus_cables_mpa, Area=circularcs_2.A, PreTension=explode_tree_2.Branch1)
bar = Bar(Line=struts_3, EModulus=e_modulus_struts_mpa, Area=circularcs.A)

# ---- group: Bars seflweight
barlength = BarLength(Bars=radial_cables_3)  # -> Points, expr("x/1000", NodalLengths)
barlength_2 = BarLength(Bars=struts_3)  # -> Points, expr("x/1000", NodalLengths)
barlength_3 = BarLength(Bars=vertical_cables_3)  # -> Points, expr("x/1000", NodalLengths)
density_rubber = Panel("1000")
barselfweight = BarSelfweight(NodalLengths=barlength_2.NodalLengths, CrossSectionArea=circularcs.A, MaterialDensity=materials.Density)  # -> simplify(NodalSelfweight)
barselfweight_2 = BarSelfweight(NodalLengths=barlength.NodalLengths, CrossSectionArea=circularcs_2.A, MaterialDensity=density_rubber)  # -> simplify(NodalSelfweight)
barselfweight_3 = BarSelfweight(NodalLengths=barlength_3.NodalLengths, CrossSectionArea=circularcs_2.A, MaterialDensity=density_rubber)  # -> simplify(NodalSelfweight)
load_2 = Load(Point=simplify(barlength_2.Points), NodalForce=barselfweight)
load_3 = Load(Point=simplify(barlength.Points), NodalForce=barselfweight_2)
load_4 = Load(Point=simplify(barlength_3.Points), NodalForce=barselfweight_3)
mass_addition = MassAddition(Input=flatten([barselfweight, barselfweight_2, barselfweight_3]))  # -> Result, PartialResults
vector_length = VectorLength(Vector=mass_addition.Result)
kg = Number(expr("x/10", vector_length))
total_mass_of_unit_s_kg = Panel(kg)

# ----
total_mass_of_units = Panel(vector_length)

# ---- group: Constraints on bars
end_points_3 = EndPoints(Curve=unflatten_tree_2)  # -> Start, End
cull_duplicates_3 = CullDuplicates(Points=[end_points_3.Start, end_points_3.End], Tolerance=0.1, CullMode=3)  # -> flatten(Points), Indices, Valence
number_slider_4 = Slider(1000, range=0..1000000)
collider_2 = Collider(Objects=flatten(unflatten_tree_2), Radii=Slider(1, range=0..5), Strength=Slider(10000, range=0..10000))
floor_2 = Floor(Strength=Slider(100, range=0..1000))
floorfriction_2 = FloorFriction(Points=cull_duplicates_3.Points, Limit=0.1, Strength=Slider(5, range=0..10))
spc = SolidPointCollide(
    Points=cull_duplicates_3.Points,
    Solid=resize_box.box,
    Interior=Toggle(True),
    Unidirectional=True,
    Strength=number_slider_4)

# ---- group: Solid plate to apply load
resize_box_2 = ResizeBox(
    base_rectangle_width=resize_box.final_rectangle_width,
    factor_width=Slider(1.01, range=0..10),
    base_rectangle_height=height,
    factor_height=Slider(0.5, range=0..1))  # -> box, rectangle_2, final_rectangle_width
unit_z_4 = UnitZ(Factor=Slider(82, range=0..1300))
move_4 = Move(Geometry=resize_box_2.rectangle_2, Motion=unit_z_4)  # -> Geometry, Transform
panel_3 = Panel("50")
box_rectangle_2 = BoxRectangle(Rectangle=move_4.Geometry, Height=panel_3)
qrsettings = QuadRemeshSettings(
    TargetCount=Slider(70, range=0..100),
    AdaptiveSize=0,
    AdaptiveCount=False,
    HardEdges=invert(False),
    SeamEdges=1,
    Symmetry=0,
    GuideCurves=0)
edges = BrepEdges(Brep=box_rectangle_2)  # -> Naked, Interior, NonManifold
mesh = MeshBrep(
    Brep=box_rectangle_2,
    Settings={GridMaxCount=0, GridMinCount=16, JaggedSeams=False, MaxEdgeLength=0, MinEdgeLength=0.0001, MinTolerance=0, Refine=True, RefineAngle=0, RelativeTolerance=0.65, SimplePlanes=True, Tolerance=0})
qrmesh = QuadRemesh(Mesh=mesh, Guides=edges.Interior, Settings=qrsettings)
nv = NakedVertices(Mesh=qrmesh)  # -> ClothedIndex, NakedIndex, ClothedPts, NakedPts
point = Point(nv.NakedPts)
item = ListItem(List=nv.NakedPts, Index=0, Wrap=True)  # -> Item, Item1
item_2 = ListItem(List=nv.NakedPts, Index=Slider(4, range=0..10), Wrap=True)  # -> Item, Item1
pt = Point([nv.ClothedPts, nv.NakedPts])
number_slider_5 = Slider(300, range=0..1000)
number_slider_6 = Slider(300, range=0..1000)
ln = Line(StartPoint=item.Item, EndPoint=item.Item1)
ln_2 = Line(StartPoint=item_2.Item, EndPoint=item_2.Item1)
end = EndPoints(Curve=struts_3)  # -> Start, End
number_slider_7 = Slider(5000, range=0..100000)
ext = ExtendCurve(Curve=ln, Type=0, Start=number_slider_5, End=number_slider_5)
ext_2 = ExtendCurve(Curve=ln_2, Type=0, Start=number_slider_6, End=number_slider_6)
cull_duplicates_4 = CullDuplicates(Points=pt, Tolerance=0.1, CullMode=3)  # -> Points, Indices, Valence
pt_2 = Point([end.Start, end.End])
end_2 = EndPoints(Curve=ext)  # -> Start, End
end_3 = EndPoints(Curve=ext_2)  # -> Start, End
rigidbody = RigidBody(Part=qrmesh, Points=cull_duplicates_4.Points, Strength=10)  # -> RigidBody, Planes
solidpointcollide_3 = SolidPointCollide(Points=pt_2, Solid=qrmesh, Interior=False, Unidirectional=False, Strength=number_slider_4)
rigidpointset = RigidPointSet(Points=pt, Strength=number_slider_7)  # -> RigidBody, Planes
colinear = CoLinear(Points=[item.Item, item.Item1, end_2.Start, end_2.End], Strength=number_slider_7)
anchor = Anchor(Point=[end_2.Start, end_2.End], Strength=number_slider_7)
colinear_2 = CoLinear(Points=[item_2.Item, item_2.Item1, end_3.Start, end_3.End], Strength=number_slider_7)
anchor_2 = Anchor(Point=[end_3.Start, end_3.End], Strength=number_slider_7)
point_2 = Point(rigidbody.Planes)
entwine_8 = Entwine(Branch00=colinear_2, Branch01=anchor_2, FlattenInputs=True)
entwine_9 = Entwine(Branch00=colinear, Branch01=anchor, FlattenInputs=True)

# ---- group: Load added on the structure
multiplication_4 = Multiplication(A=panel_3, B="1/2")
unit_z_5 = UnitZ(Factor=multiplication_4)
move_5 = Move(Geometry=point_2, Motion=unit_z_5)  # -> Geometry, Transform
unit_x = UnitX(Factor=Slider(50, range=0..50))
reverse = Reverse(Vector=unit_x)
move_6 = Move(Geometry=move_5.Geometry, Motion=reverse)  # -> Geometry, Transform
move_7 = Move(Geometry=move_5.Geometry, Motion=unit_x)  # -> Geometry, Transform
line = Line(StartPoint=move_7.Geometry, EndPoint=move_6.Geometry)
diameter = Slider(57.4751, range=0..100)
materials_2 = Materials(MaterialIndex=Slider(0, range=0..7))  # -> MaterialName, Density, YoungsModulus, ShearModulus, Strength
barlength_4 = BarLength(Bars=line)  # -> Points, expr("x/1000", NodalLengths)
circularcs_3 = CircularCS(Diameter=diameter)  # -> A, I, Z, It
barselfweight_4 = BarSelfweight(NodalLengths=barlength_4.NodalLengths, CrossSectionArea=circularcs_3.A, MaterialDensity=materials_2.Density)  # -> simplify(NodalSelfweight)
panel_4 = Panel(materials_2.MaterialName)
bar_2 = Bar(Line=line, EModulus=materials_2.YoungsModulus, Area=circularcs_3.A)
load_5 = Load(Point=simplify(barlength_4.Points), NodalForce=barselfweight_4)
mass_addition_2 = MassAddition(Input=flatten(barselfweight_4))  # -> Result, PartialResults
solidpointcollide_4 = SolidPointCollide(
    Points=[move_6.Geometry, move_7.Geometry],
    Solid=qrmesh,
    Interior=False,
    Unidirectional=False,
    Strength=Slider(100, range=0..100))
vector_length_2 = VectorLength(Vector=mass_addition_2.Result)
load_n = Panel(vector_length_2)
kg_2 = Number(expr("x/10", vector_length_2))
mass_kg = Panel(kg_2)

# ----
unit_z_6 = UnitZ(Factor=Slider(20, range=-20..20))
unit_z_7 = UnitZ(Factor=Slider(-50, range=-50..20))
unit_z_8 = UnitZ(Factor=Slider(20, range=-20..20))
unit_z_9 = UnitZ(Factor=Slider(-50, range=-50..20))
number_slider_8 = Slider(1000, range=0..1000)
move_8 = Move(Geometry=move_7.Geometry, Motion=unit_z_6)  # -> Geometry, Transform
move_9 = Move(Geometry=move_7.Geometry, Motion=unit_z_7)  # -> Geometry, Transform
move_10 = Move(Geometry=move_6.Geometry, Motion=unit_z_8)  # -> Geometry, Transform
move_11 = Move(Geometry=move_6.Geometry, Motion=unit_z_9)  # -> Geometry, Transform
line_2 = Line(StartPoint=move_8.Geometry, EndPoint=move_9.Geometry)
line_3 = Line(StartPoint=move_10.Geometry, EndPoint=move_11.Geometry)
show = Show(G=[move_7.Geometry, move_6.Geometry])
colinear_3 = CoLinear(Points=[move_9.Geometry, move_8.Geometry, move_7.Geometry], Strength=number_slider_8)
anchor_3 = Anchor(Point=[move_8.Geometry, move_9.Geometry], Strength=number_slider_8)
colinear_4 = CoLinear(Points=[move_6.Geometry, move_10.Geometry, move_11.Geometry], Strength=number_slider_8)
anchor_4 = Anchor(Point=[move_10.Geometry, move_11.Geometry], Strength=number_slider_8)
entwine_10 = Entwine(Branch00=colinear_3, Branch01=anchor_3, FlattenInputs=True)
entwine_11 = Entwine(Branch00=colinear_4, Branch01=anchor_4, FlattenInputs=True)
bars = Entwine(Branch00=bar, Branch01=cable, Branch02=cable_2, Branch03=bar_2, FlattenInputs=True)
loads = Entwine(Branch00=load_2, Branch01=load_3, Branch02=load_4, Branch03=load_5, FlattenInputs=True)
collisions = Entwine(Branch00=collider_2, Branch01=spc, Branch02=solidpointcollide_3, Branch03=solidpointcollide_4, FlattenInputs=True)
others = Entwine(
    Branch00=rigidbody.RigidBody,
    Branch01=floor_2,
    Branch02=floorfriction_2,
    Branch03=rigidpointset.RigidBody,
    Branch04=entwine_9,
    Branch05=entwine_8,
    Branch06=entwine_10,
    Branch07=entwine_11,
    Branch08=show,
    FlattenInputs=True)
entwine_12 = Entwine(Branch00=bars, Branch01=loads, Branch02=collisions, Branch03=others, FlattenInputs=True)
solver_2 = Solver(GoalObjects=entwine_12, Reset=Button(), Threshold="1e-15", Tolerance=0.0001, On=Toggle(False))  # -> I, V, O
explode_tree_3 = ExplodeTree(Data=solver_2.O)  # -> Branch0, Branch1, Branch2, Branch3
unflatten_tree_3 = UnflattenTree(Tree=explode_tree_3.Branch0, Guide=bars)
list_item = ListItem(List=explode_tree_3.Branch3, Index=0, Wrap=True)  # -> Item2, Item1, Item
point_3 = Point([list_item.Item1, list_item.Item2])
explode_tree_4 = ExplodeTree(Data=unflatten_tree_3)  # -> Branch0, Branch1, Branch2, Branch3
baroutput = BarOutput(BarData=explode_tree_4.Branch0)  # -> Line, AxialForce, AxialStress
baroutput_2 = BarOutput(BarData=explode_tree_4.Branch1)  # -> Line, AxialForce, AxialStress
baroutput_3 = BarOutput(BarData=explode_tree_4.Branch2)  # -> Line, AxialForce, AxialStress

# ---- group: bar to aplly load (no post analyse)
baroutput_4 = BarOutput(BarData=explode_tree_4.Branch3)  # -> Line, AxialForce, AxialStress

# ----
deconstruct_mesh = DeconstructMesh(Mesh=list_item.Item)  # -> Vertices, Faces, Colours, Normals
custom_preview_5 = CustomPreview(Geometry=list_item.Item, Material=ColourSwatch(SwatchColor=RGBA(0, 42, 255, 198)))
pipe_3 = Pipe(Curve=baroutput_4.Line, Radius=1, Caps=0)
entwine_13 = Entwine(Branch00=baroutput.Line, Branch01=baroutput_2.Line, Branch02=baroutput_3.Line, FlattenInputs=True)  # -> flatten(Result)
entwine_14 = Entwine(Branch00=baroutput.AxialForce, Branch01=baroutput_2.AxialForce, Branch02=baroutput_3.AxialForce, FlattenInputs=True)  # -> flatten(Result)
entwine_15 = Entwine(Branch00=baroutput_2.AxialForce, Branch01=baroutput_3.AxialForce, FlattenInputs=True)  # -> flatten(Result)
custom_preview_6 = CustomPreview(Geometry=pipe_3, Material=ColourSwatch(SwatchColor=RGB(36, 94, 19)))
unit_z_10 = UnitZ(Factor=1)  # -> expr("x/1000", UnitVector)
curve_middle = CurveMiddle(Curve=baroutput_2.Line)
length_5 = Length(Curve=baroutput_2.Line)
curve_middle_2 = CurveMiddle(Curve=baroutput.Line)
curve_middle_3 = CurveMiddle(Curve=baroutput_3.Line)
length_6 = Length(Curve=baroutput.Line)
length_7 = Length(Curve=baroutput_3.Line)
number = Number(expr("x*1000", baroutput_2.AxialForce))
number_2 = Number(expr("x*1000", baroutput_3.AxialForce))
number_3 = Number(expr("x*1000", baroutput_3.AxialForce))
sort_list = SortList(Keys=entwine_15)  # -> reverse(Keys), ValuesValuesA
sort_list_2 = SortList(Keys=baroutput.AxialForce)  # -> Keys, ValuesValuesA
list_item_2 = ListItem(List=deconstruct_mesh.Vertices, Index=0, Wrap=True)
colour_swatch = ColourSwatch(SwatchColor=RGB(0, 0, 0))
move_12 = Move(Geometry=curve_middle, Motion=unit_z_10)  # -> Geometry, Transform
axialvisualisation = AxialVisualisation(Line=entwine_13, AxialForces=entwine_14, ThicknessMax=Slider(6, range=0..10))
deconstruct = Deconstruct(Point=list_item_2)  # -> XComponent, YComponent, flatten(ZComponent)
average = Average(Input=sort_list.Keys)
average_2 = Average(Input=sort_list_2.Keys)
list_item_3 = ListItem(List=sort_list.Keys, Index=0, Wrap=True)
list_item_4 = ListItem(List=sort_list_2.Keys, Index=0, Wrap=True)
text_tag = TextTag(Location=curve_middle, Text=number, Colour=colour_swatch)
text_tag_2 = TextTag(Location=curve_middle_2, Text=length_6, Colour=colour_swatch)
text_tag_3 = TextTag(Location=curve_middle_2, Text=number_2, Colour=ColourSwatch(SwatchColor=RGB(209, 0, 0)))
text_tag_4 = TextTag(Location=move_12.Geometry, Text=length_5, Colour=colour_swatch)
text_tag_5 = TextTag(Location=curve_middle_3, Text=length_7, Colour=colour_swatch)
text_tag_6 = TextTag(Location=curve_middle_3, Text=number_3, Colour=colour_swatch)
plate_s_height_mm = Panel(deconstruct.ZComponent)
max_force_in_cables_kn = Panel(list_item_3)
average_force_in_cables_kn = Panel(average)
max_force_in_struts_kn = Panel(list_item_4)
average_force_in_struts_kn = Panel(average_2)
entwine_16 = Entwine(
    Branch00=plate_s_height_mm,
    Branch01=max_force_in_cables_kn,
    Branch02=average_force_in_cables_kn,
    Branch03=max_force_in_struts_kn,
    Branch04=average_force_in_struts_kn,
    FlattenInputs=True)  # -> simplify(Result)
panel_5 = Panel(entwine_16)
data_recorder = DataRecorder(entwine_16, DataLimit=-10, RecordData=False)
data = Data(data_recorder)
panel_6 = Panel(data)

# ---- group: Export to excel file
panel_7 = Panel("""Plate's Height
Max force in cables (kN)
Average force in cable(kN)
Max force in struts
Average force in struts""")
panel_8 = Panel("C:\Users\lucien\Desktop\Semester Project LIS\gh_compression30units\icos_30N.xlsx")
excel_write = ExcelWrite(
    WriteExcelData=Toggle(False),
    WorkbookPath=panel_8,
    WorksheetName="Feuil1",
    ColumnHeadings=panel_7,
    ClearSheet=Toggle(True))
panel_9 = Panel(excel_write)

# ==== cluster DispatchElements
geometry = ClusterInput()
geometry_2 = Data(geometry)
split_tree = SplitTree(Data=geometry_2, Masks=flatten("{0;*}"))  # -> Positive, Negative
split_tree_2 = SplitTree(Data=split_tree.Negative, Masks=flatten("{1;*}"))  # -> Positive, Negative
radial_cables = Line(split_tree_2.Positive)
vertical_cables = Line(split_tree_2.Negative)
struts = Line(split_tree.Positive)
struts_2 = ClusterOutput(struts)
radial_cables_2 = ClusterOutput(radial_cables)
vertical_cables_2 = ClusterOutput(vertical_cables)

# ==== cluster Star3
radius = Slider(50, range=0..50)
nb_of_struts = Slider(3, range=0..10)
polygon = Polygon(Plane=PlaneXY(0, 0, 0), Radius=radius, Segments=nb_of_struts, FilletRadius=0)  # -> Polygon, Length
height = Slider(80, range=0..100)
unit_z = UnitZ(Factor=Slider(0, range=0..50))
move = Move(Geometry=polygon.Polygon, Motion=unit_z)  # -> Geometry, Transform
rotate = Rotate(Geometry=move.Geometry, Angle=Slider(3, range=0..3), Plane=PlaneXY(0, 0, 0))  # -> Geometry, Transform
unit_z_2 = UnitZ(Factor=height)
move_2 = Move(Geometry=rotate.Geometry, Motion=unit_z_2)  # -> Geometry, Transform
control_points = ControlPoints(Curve=move.Geometry)  # -> Points, Weights, Knots
control_points_2 = ControlPoints(Curve=move_2.Geometry)  # -> Points, Weights, Knots
removeduplicatepts = RemoveDuplicatePts(Points=control_points.Points, Tolerance=0.01)
removeduplicatepts_2 = RemoveDuplicatePts(Points=control_points_2.Points, Tolerance=0.01)
polygon_center = PolygonCenter(Polyline=move_2.Geometry)  # -> CenterV, CenterE, CenterA
polygon_center_2 = PolygonCenter(Polyline=move.Geometry)  # -> CenterV, CenterE, CenterA
shift_list = ShiftList(List=removeduplicatepts, Shift="1", Wrap=True)
line = Line(StartPoint=removeduplicatepts, EndPoint=removeduplicatepts_2)
line_2 = Line(StartPoint=polygon_center_2.CenterV, EndPoint=removeduplicatepts)
line_3 = Line(StartPoint=polygon_center.CenterV, EndPoint=removeduplicatepts_2)
line_4 = Line(StartPoint=removeduplicatepts_2, EndPoint=shift_list)
vertical_cables = Line(line_4)
radial_cables = Line([line_2, line_3])
struts = Line(line)
struts_2 = ClusterOutput(struts)
radial_cables_2 = ClusterOutput(radial_cables)
vertical_cables_2 = ClusterOutput(vertical_cables)
length = Length(Curve=vertical_cables)
length_2 = Length(Curve=radial_cables)
panel = Panel(length_2)
panel_2 = Panel(length)

# ==== cluster T3
radius = Slider(50, range=0..50)
nb_of_struts = Slider(3, range=0..10)
polygon = Polygon(Plane=PlaneXY(0, 0, 0), Radius=radius, Segments=nb_of_struts, FilletRadius=0)  # -> Polygon, Length
unit_z = UnitZ(Factor=Slider(0, range=0..50))
height = Slider(80, range=0..100)
move = Move(Geometry=polygon.Polygon, Motion=unit_z)  # -> Geometry, Transform
rotate = Rotate(Geometry=move.Geometry, Angle=Slider(2.2, range=0..3), Plane=PlaneXY(0, 0, 0))  # -> Geometry, Transform
unit_z_2 = UnitZ(Factor=height)
move_2 = Move(Geometry=rotate.Geometry, Motion=unit_z_2)  # -> Geometry, Transform
control_points = ControlPoints(Curve=move.Geometry)  # -> Points, Weights, Knots
control_points_2 = ControlPoints(Curve=move_2.Geometry)  # -> Points, Weights, Knots
removeduplicatepts = RemoveDuplicatePts(Points=control_points.Points, Tolerance=0.01)
removeduplicatepts_2 = RemoveDuplicatePts(Points=control_points_2.Points, Tolerance=0.01)
shift_list = ShiftList(List=removeduplicatepts, Shift="1", Wrap=True)
shift_list_2 = ShiftList(List=removeduplicatepts_2, Shift="1", Wrap=True)
line = Line(StartPoint=removeduplicatepts, EndPoint=removeduplicatepts_2)
line_2 = Line(StartPoint=shift_list_2, EndPoint=removeduplicatepts_2)
line_3 = Line(StartPoint=shift_list, EndPoint=removeduplicatepts)
line_4 = Line(StartPoint=removeduplicatepts_2, EndPoint=shift_list)
vertical_cables = Line(line_4)
radial_cables = Line([line_3, line_2])
struts = Line(line)
radial_cables_2 = ClusterOutput(radial_cables)
vertical_cables_2 = ClusterOutput(vertical_cables)
struts_2 = ClusterOutput(struts)

# ==== cluster Icosahedron
multiplication = Multiplication(A="pi", B=Slider(0.207, range=-1..1))
unit_z = UnitZ(Factor=Slider(44, range=0..50))
weaverbird_s_mesh_mesh_icosahedron = WeaverbirdsMeshMeshIcosahedron(Plane=PlaneXY(0, 0, 0), Radius=Slider(55, range=0..70))
rotate_3d = Rotate3D(Geometry=weaverbird_s_mesh_mesh_icosahedron, Angle=multiplication, Center=Point(0, 0, 0), Axis="{0,1,0}")  # -> Geometry, Transform
move = Move(Geometry=rotate_3d.Geometry, Motion=unit_z)  # -> Geometry, Transform
deconstruct_mesh = DeconstructMesh(Mesh=move.Geometry)  # -> Vertices, Faces, Colours, Normals
removeduplicatepts = RemoveDuplicatePts(Points=deconstruct_mesh.Vertices, Tolerance=0.01)
list_item = ListItem(List=removeduplicatepts, Index=0, Wrap=True)  # -> Item, Item1, Item2, Item3, Item4, Item5, Item6, Item7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
line = Line(StartPoint=list_item.Item, EndPoint=list_item.Item3)
line_2 = Line(StartPoint=list_item.Item, EndPoint=list_item.Item1)

line_3 = Line(StartPoint=list_item.Item2, EndPoint=list_item.Item11)
line_4 = Line(StartPoint=list_item.Item5, EndPoint=list_item.Item6)
line_5 = Line(StartPoint=list_item.Item8, EndPoint=list_item.Item10)
line_6 = Line(StartPoint=list_item.Item, EndPoint=list_item.Item9)
line_7 = Line(StartPoint=list_item.Item1, EndPoint=list_item.Item3)
line_8 = Line(StartPoint=list_item.Item4, EndPoint=list_item.Item7)

line_9 = Line(StartPoint=list_item.Item5, EndPoint=list_item.Item)
line_10 = Line(StartPoint=list_item.Item10, EndPoint=list_item.Item5)
line_11 = Line(StartPoint=list_item.Item9, EndPoint=list_item.Item8)
line_12 = Line(StartPoint=list_item.Item9, EndPoint=list_item.Item4)
line_13 = Line(StartPoint=list_item.Item4, EndPoint=list_item.Item8)
line_14 = Line(StartPoint=list_item.Item8, EndPoint=list_item.Item7)
line_15 = Line(StartPoint=list_item.Item8, EndPoint=list_item.Item11)
line_16 = Line(StartPoint=list_item.Item2, EndPoint=list_item.Item6)
line_17 = Line(StartPoint=list_item.Item2, EndPoint=list_item.Item7)
line_18 = Line(StartPoint=list_item.Item6, EndPoint=list_item.Item10)
line_19 = Line(StartPoint=list_item.Item6, EndPoint=list_item.Item1)
line_20 = Line(StartPoint=list_item.Item10, EndPoint=list_item.Item9)
line_21 = Line(StartPoint=list_item.Item11, EndPoint=list_item.Item7)
line_22 = Line(StartPoint=list_item.Item5, EndPoint=list_item.Item1)
line_23 = Line(StartPoint=list_item.Item2, EndPoint=list_item.Item1)
line_24 = Line(StartPoint=list_item.Item6, EndPoint=list_item.Item11)
line_25 = Line(StartPoint=list_item.Item10, EndPoint=list_item.Item11)
line_26 = Line(StartPoint=list_item.Item5, EndPoint=list_item.Item9)
line_27 = Line(StartPoint=list_item.Item, EndPoint=list_item.Item4)
line_28 = Line(StartPoint=list_item.Item3, EndPoint=list_item.Item2)
line_29 = Line(StartPoint=list_item.Item3, EndPoint=list_item.Item7)
line_30 = Line(StartPoint=list_item.Item3, EndPoint=list_item.Item4)
cables = Line([line, line_2, line_9, line_22, line_27, line_30, line_29, line_28, line_16, line_17, line_23, line_24, line_18, line_19, line_25, line_20, line_10, line_26, line_11, line_12, line_13, line_14, line_15, line_21])
struts = Line([line_6, line_7, line_3, line_8, line_4, line_5])
move_2 = Move(Motion=Vector(0, 0, 10))  # -> Geometry, Transform
list_length = ListLength(List=cables)  # -> expr("x/2", Length)
dispatch = Dispatch(List=cables, DispatchPattern=[True, False])  # -> ListA, ListB
split_list = SplitList(List=cables, Index=list_length)  # -> ListA, ListB
struts_2 = ClusterOutput(struts)
cables_1 = ClusterOutput(dispatch.ListA)
cables_2 = ClusterOutput(dispatch.ListB)
line_31 = Line(dispatch.ListA)

# ==== cluster ResizeBox
base_rectangle_width = ClusterInput()
factor_width = ClusterInput()
multiplication = Multiplication(A=base_rectangle_width, B=factor_width)
negative = Negative(Value=multiplication)
construct_domain = ConstructDomain(DomainStart=negative, DomainEnd=multiplication)
base_rectangle_height = ClusterInput()
factor_height = ClusterInput()
rectangle = Rectangle(Plane=PlaneXY(0, 0, 0), XSize=construct_domain, YSize=construct_domain, Radius=0)  # -> Rectangle, Length
multiplication_2 = Multiplication(A=base_rectangle_height, B=factor_height)
box_rectangle = BoxRectangle(Rectangle=rectangle.Rectangle, Height=multiplication_2)
final_rectangle_width = ClusterOutput(multiplication)
rectangle_2 = ClusterOutput(rectangle.Rectangle)
box = ClusterOutput(box_rectangle)

# ==== cluster Axis
nb_of_units = ClusterInput()
seed = ClusterInput()
multiplication = Multiplication(A=nb_of_units, B="6")
random = Random(Range=Domain(0, 1), Number=multiplication, Seed=seed)
partition_list = PartitionList(List=random, Size=nb_of_units)
explode_tree = ExplodeTree(Data=partition_list)  # -> Branch0, Branch1, Branch2, Branch3, Branch4, Branch5
construct_point = ConstructPoint(XCoordinate=explode_tree.Branch0, YCoordinate=explode_tree.Branch1, ZCoordinate=explode_tree.Branch2)  # -> flatten(Point)
construct_point_2 = ConstructPoint(XCoordinate=explode_tree.Branch3, YCoordinate=explode_tree.Branch4, ZCoordinate=explode_tree.Branch5)  # -> flatten(Point)
vector_2pt = Vector2Pt(PointA=construct_point, PointB=construct_point_2, Unitize=False)  # -> Vector, Length
vector = ClusterOutput(vector_2pt.Vector)
