# Grasshopper definition test4.gh (Grasshopper 1.0.8)
# plug-ins: RhinoCodePluginGH, Human, Kangaroo2 Components

trigger = Trigger(Interval=50, TimerInterval=50, Target=python_3_script)  # disabled
geometry = Slider(3, range=0..3)
seed = Slider(0, range=0..2)
star_3 = Star3()  # -> flatten(geometry_2)
cluster = T3()  # -> flatten(geometry_2)
icosahedron = Icosahedron()  # -> flatten(geometry_2)
sphere_ish = SphereIsh()  # -> flatten(geometry)
python_3_script = Python3Script(On=Toggle(False), Reset=Button())  # -> out, geometry, seed, pulse
# ---------- python_3_script: Python ----------
import time  # Import time for delays

# Inputs
run_simulation = On  # Boolean toggle to enable/disable the code execution
reset_button = Reset  # Button to reset the process

geometry_ids = [0, 1, 2, 3, 4, 5, 6, 7, 8]  # List of geometry indices
seeds = [0, 1, 2]  # List of seed numbers

# Persistent variables for state tracking
if 'current_geometry' not in globals() or reset_button:
    current_geometry = 0
    current_seed = 0
    reset_triggered = True
    iteration_timer = None  # Timer to manage 5-second delay
    delay_active = False  # Indicates if the 1-second delay is active
else:
    reset_triggered = False

# Outputs
geometry = geometry_ids[current_geometry]  # Default to current geometry
seed = seeds[current_seed]  # Default to current seed
pulse = False  # Initialize pulse to False by default

# If reset button is triggered, set pulse to True
if reset_button:
    pulse = True
else:
    # Run simulation if toggle is enabled and not during reset
    if run_simulation and not reset_triggered:
        # If not waiting for the next iteration, start the 5-second timer
        if iteration_timer is None:
            iteration_timer = time.time()  # Start the 5-second delay
            delay_active = False

        # Check if 5 seconds have passed
        if time.time() - iteration_timer >= 5: # Iterate everey x seconds
            iteration_timer = None  # Reset the 5-second timer

            # Proceed with the next iteration only if not in delay phase
            if not delay_active:
                # Increment seed
                current_seed += 1

                # Check if we finished all seeds for the current geometry
                if current_seed >= len(seeds):
                    current_seed = 0
                    current_geometry += 1

                    # Check if we finished all geometries
                    if current_geometry >= len(geometry_ids):
                        current_geometry = 0
                        run_simulation = False  # Stop simulation

                # Update geometry and seed outputs after incrementation
                geometry = geometry_ids[current_geometry]
                seed = seeds[current_seed]

                # Make a pulse after incrementing
                pulse = True

    # Ensure outputs are always set
    else:
        # geometry and seed are already assigned their current values
        pass
# ---------- end python_3_script ----------
panel = Panel(python_3_script.pulse)
stream_filter = StreamFilter(Gate=geometry, Stream0=star_3, Stream1=cluster, Stream2=icosahedron, Stream3=sphere_ish)
curve = Curve(simplify(graft(stream_filter)))
geometry_2 = Panel(python_3_script.geometry)
seed_2 = Panel(python_3_script.seed)
unit_z = UnitZ(Factor=Slider(300, range=0..1000))
list_length = ListLength(List=stream_filter)
_70 = Data([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])
_10 = Data([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])
_30 = Data([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])
_50 = Data([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])
_20 = Data([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])
_40 = Data([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])
_60 = Data([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])
_80 = Data([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])
_90 = Data([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])
partition_list = PartitionList(List=_90, Size=list_length)  # -> simplify(Chunks)
path_mapper = PathMapper(partition_list, source="{A}", target="{A+10}")
data = Data(path_mapper)
number_slider = Slider(5, range=0..100)
floor = Floor(Strength=number_slider)
reset = Boolean(python_3_script.pulse)
seed_3 = Slider(9, range=0..10)
geometry_3 = Number(geometry)
seed_4 = Number(seed)
_100_icosahedrons = Data([Line((-56.88968799, -137.2681749, 6.911528923), (-80.72687883, -208.8096221, 45.78847676)), Line((162.0945222, 70.52228819, 246.1952888), (145.9305726, 16.05302152, 183.1931979)), Line((178.734428, -17.9570626, 39.23619252), (132.9586134, 41.73071339, -9.700533819e-05)), Line((-80.76890113, -54.19703084, 57.28363327), (-60.59951664, -38.39673092, 138.1597169)), Line((-40.92853814, 88.50495482, 72.19844581), (41.22079359, 79.05473091, 91.1592785)), Line((87.66071607, 143.8630366, 232.5895286), (122.7860096, 140.7662369, 155.4273667))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])
_100_star_3 = Data([Line((16.11821358, 64.51330138, 84.79040412), (-83.71377387, 91.77785593, -0.0001712722737)), Line((266.265918, 105.8720546, 205.3468213), (325.1981473, 43.59282326, 102.6422492)), Line((200.0681097, 62.5505018, 0.5735100315), (196.7413134, -42.21089042, 83.72015501)), Line((60.5474741, 99.10243513, 150.8175207), (30.21819174, -30.08243019, 133.7558605)), Line((140.5063351, 321.039625, 1.617376676), (100.4199706, 263.969648, 115.7939518)), Line((62.69311441, 208.4035892, 157.4455261), (107.0981809, 97.01300311, 216.7765928))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])
_100_t3 = Data([Line((35.76796587, -137.7890394, 75.90535943), (-46.67862248, -210.6720493, -0.0002169429946)), Line((61.65956114, 115.060096, 111.0751653), (100.8788486, 14.26757348, 189.655997)), Line((193.14471, 63.655332, -0.0002628637708), (218.4876952, -39.39733808, 81.29665349)), Line((9.176683786, 130.1717515, 100.6833894), (-7.153672688, 256.7651497, 140.427884)), Line((107.3447115, 200.2683775, 49.78638308), (83.73025962, 331.150033, 63.36628778)), Line((93.57334746, 457.5953004, -4.312863078e-05), (-19.78754916, 449.6052666, 70.41099364))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])
end_points = EndPoints(Curve=_100_t3)  # -> Start, End
bounds_2d = Bounds2D(Coordinates=end_points.End)
_100star3_seed0 = Data([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, "Grasshopper.Kernel.Types.GH_ObjectWrapper", "Grasshopper.Kernel.Types.GH_ObjectWrapper", "Grasshopper.Kernel.Types.GH_ObjectWrapper", "Grasshopper.Kernel.Types.GH_ObjectWrapper", "Grasshopper.Kernel.Types.GH_ObjectWrapper"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])
_100ico_seed0 = Data([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, "Grasshopper.Kernel.Types.GH_ObjectWrapper", "Grasshopper.Kernel.Types.GH_ObjectWrapper", "Grasshopper.Kernel.Types.GH_ObjectWrapper", "Grasshopper.Kernel.Types.GH_ObjectWrapper", "Grasshopper.Kernel.Types.GH_ObjectWrapper"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])
_100t3_seed0 = Data([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, "Grasshopper.Kernel.Types.GH_ObjectWrapper", "Grasshopper.Kernel.Types.GH_ObjectWrapper", "Grasshopper.Kernel.Types.GH_ObjectWrapper", "Grasshopper.Kernel.Types.GH_ObjectWrapper", "Grasshopper.Kernel.Types.GH_ObjectWrapper"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])
circle_fit = CircleFit(Points=[end_points.Start, end_points.End])  # -> Circle, Radius, Deviation
deconstruct_domain² = DeconstructDomain²(Domain=bounds_2d)  # -> UComponent, VComponent
panel_2 = Panel(circle_fit.Radius)
_100icos_final_0 = Data([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])
_100star3_final_0 = Data([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])
_100t3_final_0 = Data([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])
_100spheres = Data([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])
rectangle = Rectangle(Plane=PlaneXY(0, 0, 0), XSize=deconstruct_domain².UComponent, YSize=deconstruct_domain².VComponent, Radius=0)  # -> Rectangle, Length
panel_3 = Panel(rectangle.Length)
panel_4 = Panel(rectangle.Rectangle)

construct_point = ConstructPoint(XCoordinate="150", YCoordinate="150", ZCoordinate="1200")
nb_of_units = Slider(100, range=1..200)
box_2pt = Box2Pt(PointA="{0,0,100}", PointB=construct_point, Plane=PlaneXY(0, 0, 0))
unit_z_2 = UnitZ(Factor=Slider(1, range=0..10))

multiplication = Multiplication(A=nb_of_units, B="6")
random = Random(Range=Domain(0, 1), Number=multiplication, Seed=seed_3)
move = Move(Geometry=box_2pt, Motion=unit_z)  # -> Geometry, Transform
partition_list_2 = PartitionList(List=random, Size=nb_of_units)
explode_tree = ExplodeTree(Data=partition_list_2)  # -> Branch0, Branch1, Branch2, Branch3, Branch4, Branch5
random_2 = Random(Range="0 To pi", Number=nb_of_units, Seed=seed_3)
construct_point_2 = ConstructPoint(XCoordinate=explode_tree.Branch0, YCoordinate=explode_tree.Branch1, ZCoordinate=explode_tree.Branch2)  # -> flatten(Point)
construct_point_3 = ConstructPoint(XCoordinate=explode_tree.Branch3, YCoordinate=explode_tree.Branch4, ZCoordinate=explode_tree.Branch5)  # -> flatten(Point)
vector_2pt = Vector2Pt(PointA=construct_point_2, PointB=construct_point_3, Unitize=False)  # -> Vector, Length
vector = Vector(vector_2pt.Vector)

populate_3d = Populate3D(Region=move.Geometry, Count=nb_of_units, Seed=seed_3)
move_2 = Move(Geometry=curve, Motion=populate_3d)  # -> simplify(Geometry), Transform
rotate_3d = Rotate3D(Geometry=move_2.Geometry, Angle=random_2, Center=populate_3d, Axis=vector)  # -> Geometry, Transform
move_3 = Move(Geometry=rotate_3d.Geometry, Motion=unit_z_2)  # -> simplify(Geometry), Transform

path_mapper_2 = PathMapper(move_3.Geometry, source="{*}[i]", target="{i}")
merge = Merge(Data1=path_mapper_2, Data2=data)
end_points_2 = EndPoints(Curve=merge)  # -> Start, End
cull_duplicates = CullDuplicates(Points=[end_points_2.Start, end_points_2.End], Tolerance=0.1, CullMode=3)  # -> simplify(Points), Indices, Valence
point = Point(flatten(cull_duplicates.Points))
list_length_2 = ListLength(List=point)
average = Average(Input=cull_duplicates.Points)
division = Division(A=Slider(10, range=0..100), B=list_length_2)
unit_z_3 = UnitZ(Factor=division)
point_2 = Point(average)
merge_2 = Merge(Data1=cull_duplicates.Points, Data2=point_2)
negative = Negative(Value=unit_z_3)
rigidpointset = RigidPointSet(Points=merge_2, Strength=10)  # -> RigidBody, Planes
line = Line(merge)
spherecollide = SphereCollide(Points=flatten(point_2), Radius=Slider(49, range=0..100), Strength=Slider(5, range=0..10))
load = Load(Point=point, ForceVector=negative, Weighting=1)
collider = Collider(Objects=flatten(line), Radii="2.5", Strength=number_slider)  # disabled
floorfriction = FloorFriction(Points=point, Limit=0.1, Strength=Slider(10, range=0..20))
show = Show(G=merge)
entwine = Entwine(
    Branch00=show,
    Branch02=floor,
    Branch03=load,
    Branch04=rigidpointset.RigidBody,
    Branch05=floorfriction,
    Branch06=spherecollide,
    Branch07=collider,
    FlattenInputs=True)
panel_5 = Panel(entwine)
solver = Solver(GoalObjects=entwine, Reset=Button(), Threshold=1e-15, Tolerance=0.0001, On=Toggle(False))  # -> I, V, O
stepsolver = StepSolver(
    GoalObjects=entwine,
    Tolerance=0.0001,
    Momentum=False,
    Damping=0.99,
    SubIterations=Slider(200, range=0..200),
    Animate=Slider(0, range=0..1220))  # -> I, V, O; disabled
explode_tree_2 = ExplodeTree(Data=solver.O)  # -> Branch0, Branch1, Branch2, Branch3, Branch4, Branch5, Branch6
gate_geometry = StreamGate(Stream=explode_tree_2.Branch0, Gate=geometry_3)  # -> Target0, Target1, Target2, Target3, Target4, Target5, Target6, Target7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
gate_seed = StreamGate(Stream=gate_geometry.Target0, Gate=seed_4)  # -> Target0, Target1, Target2
gate_seed_2 = StreamGate(Stream=gate_geometry.Target1, Gate=seed_4)  # -> Target0, Target1, Target2
gate_seed_3 = StreamGate(Stream=gate_geometry.Target2, Gate=seed_4)  # -> Target0, Target1, Target2
gate_seed_4 = StreamGate(Stream=gate_geometry.Target3, Gate=seed_4)  # -> Target0, Target1, Target2
unflatten_tree = UnflattenTree(Tree=stepsolver.O, Guide=entwine)
pipe = Pipe(Curve=explode_tree_2.Branch0, Radius="2.5", Caps=0)  # disabled
data_recorder = DataRecorder(gate_seed.Target0, DataLimit=1200, RecordData=True)
data_recorder_2 = DataRecorder(gate_seed.Target1, DataLimit=1200, RecordData=True)
data_recorder_3 = DataRecorder(gate_seed.Target2, DataLimit=1200, RecordData=True)
data_recorder_4 = DataRecorder(gate_seed_2.Target0, DataLimit=1200, RecordData=True)
data_recorder_5 = DataRecorder(gate_seed_2.Target1, DataLimit=1200, RecordData=True)
data_recorder_6 = DataRecorder(gate_seed_2.Target2, DataLimit=1200, RecordData=True)
data_recorder_7 = DataRecorder(gate_seed_3.Target1, DataLimit=3000, RecordData=True)
data_recorder_8 = DataRecorder(gate_seed_3.Target2, DataLimit=3000, RecordData=True)
data_recorder_9 = DataRecorder(gate_seed_3.Target0, DataLimit=3000, RecordData=True)
data_recorder_10 = DataRecorder(gate_seed_4.Target0, DataLimit=3000, RecordData=True)
data_recorder_11 = DataRecorder(gate_seed_4.Target1, DataLimit=3000, RecordData=True)
data_recorder_12 = DataRecorder(gate_seed_4.Target2, DataLimit=3000, RecordData=True)
data_2 = Data(simplify(explode_tree_2.Branch0))

# ---- group: with 150 units
star3_0 = Data([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])
star3_1 = Data([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])
star3_2 = Data([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])
t3_0 = Data([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])
sphere_1 = Data(data_recorder_11)
ico_1 = Data(data_recorder_7)
sphere_0 = Data(data_recorder_10)
t3_1 = Data(data_recorder_5)
t3_2 = Data(data_recorder_6)
sphere_2 = Data(data_recorder_12)
ico_0 = Data(data_recorder_9)
ico_2 = Data(data_recorder_8)

# ----
custom_preview = CustomPreview(Geometry=explode_tree_2.Branch0, Material=ColourSwatch(SwatchColor=RGB(191, 33, 33)))  # disabled
unflatten_tree_2 = UnflattenTree(Tree=_100spheres, Guide=path_mapper_2)
path_mapper_3 = PathMapper(unflatten_tree_2, source="{*}[i]", target="{i}")
end_points_3 = EndPoints(Curve=unflatten_tree_2)  # -> Start, End
point_3 = Point([end_points_3.Start, end_points_3.End])
bounds_2d_2 = Bounds2D(Coordinates=flatten(point_3))
average_2 = Average(Input=point_3)  # -> flatten(ArithmeticMean)
deconstruct = Deconstruct(Point=point_3)  # -> XComponent, YComponent, flatten(ZComponent)
deconstruct_domain²_2 = DeconstructDomain²(Domain=bounds_2d_2)  # -> UComponent, VComponent
sort_list = SortList(Keys=deconstruct.ZComponent)  # -> reverse(Keys), ValuesValuesA
circle_fit_2 = CircleFit(Points=average_2)  # -> Circle, Radius, Deviation
rectangle_2 = Rectangle(Plane=PlaneXY(0, 0, 0), XSize=deconstruct_domain²_2.UComponent, YSize=deconstruct_domain²_2.VComponent, Radius=0)  # -> Rectangle, Length
list_item = ListItem(List=sort_list.Keys, Index=0, Wrap=True)
fitted_circle_radius = Panel(circle_fit_2.Radius)
fitted_circle_deviation = Panel(circle_fit_2.Deviation)
custom_preview_lineweights = CustomPreviewLineweights(
    Geometry=circle_fit_2.Circle,
    Shader={diffuse=RGB(255, 105, 180), emission=RGB(76, 32, 54), shine=0.5, specular=RGB(255, 255, 255), transparency=0},
    Thickness=Slider(5, range=0..10),
    Absolute=False)  # disabled
deconstruct_rectangle = DeconstructRectangle(Rectangle=rectangle_2.Rectangle)  # -> BasePlane, XInterval, YInterval
top_most_point_height = Panel(list_item)
panel_6 = Panel(rectangle_2.Rectangle)
deconstruct_domain = DeconstructDomain(Domain=deconstruct_rectangle.XInterval)  # -> Start, End
deconstruct_domain_2 = DeconstructDomain(Domain=deconstruct_rectangle.YInterval)  # -> Start, End
subtraction = Subtraction(A=deconstruct_domain.End, B=deconstruct_domain.Start)
subtraction_2 = Subtraction(A=deconstruct_domain_2.End, B=deconstruct_domain_2.Start)

# ==== cluster Star3
radius = Slider(50, range=0..50)
nb_of_struts = Slider(3, range=0..10)
polygon = Polygon(Plane=PlaneXY(0, 0, 0), Radius=radius, Segments=nb_of_struts, FilletRadius=0)  # -> Polygon, Length
height = Slider(80, range=0..100)
unit_z = UnitZ(Factor=Slider(0, range=0..50))
multiplication = Multiplication(A=radius, B="2")
move = Move(Geometry=polygon.Polygon, Motion=unit_z)  # -> Geometry, Transform
rotate = Rotate(Geometry=move.Geometry, Angle=Slider(2.2, range=0..3), Plane=PlaneXY(0, 0, 0))  # -> Geometry, Transform
unit_z_2 = UnitZ(Factor=multiplication)
move_2 = Move(Geometry=rotate.Geometry, Motion=unit_z_2)  # -> Geometry, Transform
control_points = ControlPoints(Curve=move.Geometry)  # -> Points, Weights, Knots
control_points_2 = ControlPoints(Curve=move_2.Geometry)  # -> Points, Weights, Knots
removeduplicatepts = RemoveDuplicatePts(Points=control_points.Points, Tolerance=0.01)
removeduplicatepts_2 = RemoveDuplicatePts(Points=control_points_2.Points, Tolerance=0.01)
polygon_center = PolygonCenter(Polyline=move_2.Geometry)  # -> CenterV, CenterE, CenterA
polygon_center_2 = PolygonCenter(Polyline=move.Geometry)  # -> CenterV, CenterE, CenterA
shift_list = ShiftList(List=removeduplicatepts, Shift="1", Wrap=True)
line = Line(StartPoint=removeduplicatepts, EndPoint=removeduplicatepts_2)
line_2 = Line(StartPoint=polygon_center_2.CenterV, EndPoint=removeduplicatepts)
line_3 = Line(StartPoint=polygon_center.CenterV, EndPoint=removeduplicatepts_2)
line_4 = Line(StartPoint=removeduplicatepts_2, EndPoint=shift_list)
geometry = Curve(flatten([line, line_2, line_3, line_4]))
geometry_2 = ClusterOutput(geometry)

# ==== cluster T3
radius = Slider(50, range=0..50)
nb_of_struts = Slider(3, range=0..10)
polygon = Polygon(Plane=PlaneXY(0, 0, 0), Radius=radius, Segments=nb_of_struts, FilletRadius=0)  # -> Polygon, Length
unit_z = UnitZ(Factor=Slider(0, range=0..50))
multiplication = Multiplication(A=radius, B="2")
move = Move(Geometry=polygon.Polygon, Motion=unit_z)  # -> Geometry, Transform
rotate = Rotate(Geometry=move.Geometry, Angle=Slider(2.2, range=0..3), Plane=PlaneXY(0, 0, 0))  # -> Geometry, Transform
unit_z_2 = UnitZ(Factor=multiplication)
move_2 = Move(Geometry=rotate.Geometry, Motion=unit_z_2)  # -> Geometry, Transform
control_points = ControlPoints(Curve=move.Geometry)  # -> Points, Weights, Knots
control_points_2 = ControlPoints(Curve=move_2.Geometry)  # -> Points, Weights, Knots
removeduplicatepts = RemoveDuplicatePts(Points=control_points.Points, Tolerance=0.01)
removeduplicatepts_2 = RemoveDuplicatePts(Points=control_points_2.Points, Tolerance=0.01)
shift_list = ShiftList(List=removeduplicatepts, Shift="1", Wrap=True)
shift_list_2 = ShiftList(List=removeduplicatepts_2, Shift="1", Wrap=True)
line = Line(StartPoint=removeduplicatepts, EndPoint=removeduplicatepts_2)
line_2 = Line(StartPoint=shift_list_2, EndPoint=removeduplicatepts_2)
line_3 = Line(StartPoint=shift_list, EndPoint=removeduplicatepts)
line_4 = Line(StartPoint=removeduplicatepts_2, EndPoint=shift_list)
vertical_cables = Line(line_4)
radial_cables = Line([line_3, line_2])
struts = Line(line)
geometry = Curve([struts, radial_cables, vertical_cables])
geometry_2 = ClusterOutput(geometry)

# ==== cluster Icosahedron
number_slider = Slider(50, range=0..50)
unit_z = UnitZ(Factor=number_slider)
weaverbird_s_mesh_mesh_icosahedron = WeaverbirdsMeshMeshIcosahedron(Plane=PlaneXY(0, 0, 0), Radius=number_slider)
move = Move(Geometry=weaverbird_s_mesh_mesh_icosahedron, Motion=unit_z)  # -> Geometry, Transform
deconstruct_mesh = DeconstructMesh(Mesh=move.Geometry)  # -> Vertices, Faces, Colours, Normals
removeduplicatepts = RemoveDuplicatePts(Points=deconstruct_mesh.Vertices, Tolerance=0.01)
list_item = ListItem(List=removeduplicatepts, Index=0, Wrap=True)  # -> Item, Item1, Item2, Item3, Item4, Item5, Item6, Item7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
line = Line(StartPoint=list_item.Item, EndPoint=list_item.Item3)
line_2 = Line(StartPoint=list_item.Item, EndPoint=list_item.Item1)

line_3 = Line(StartPoint=list_item.Item2, EndPoint=list_item.Item11)
line_4 = Line(StartPoint=list_item.Item5, EndPoint=list_item.Item6)
line_5 = Line(StartPoint=list_item.Item8, EndPoint=list_item.Item10)
line_6 = Line(StartPoint=list_item.Item, EndPoint=list_item.Item9)
line_7 = Line(StartPoint=list_item.Item1, EndPoint=list_item.Item3)
line_8 = Line(StartPoint=list_item.Item4, EndPoint=list_item.Item7)

line_9 = Line(StartPoint=list_item.Item5, EndPoint=list_item.Item)
line_10 = Line(StartPoint=list_item.Item10, EndPoint=list_item.Item5)
line_11 = Line(StartPoint=list_item.Item9, EndPoint=list_item.Item8)
line_12 = Line(StartPoint=list_item.Item9, EndPoint=list_item.Item4)
line_13 = Line(StartPoint=list_item.Item4, EndPoint=list_item.Item8)
line_14 = Line(StartPoint=list_item.Item8, EndPoint=list_item.Item7)
line_15 = Line(StartPoint=list_item.Item8, EndPoint=list_item.Item11)
line_16 = Line(StartPoint=list_item.Item2, EndPoint=list_item.Item6)
line_17 = Line(StartPoint=list_item.Item2, EndPoint=list_item.Item7)
line_18 = Line(StartPoint=list_item.Item6, EndPoint=list_item.Item10)
line_19 = Line(StartPoint=list_item.Item6, EndPoint=list_item.Item1)
line_20 = Line(StartPoint=list_item.Item10, EndPoint=list_item.Item9)
line_21 = Line(StartPoint=list_item.Item11, EndPoint=list_item.Item7)
line_22 = Line(StartPoint=list_item.Item5, EndPoint=list_item.Item1)
line_23 = Line(StartPoint=list_item.Item2, EndPoint=list_item.Item1)
line_24 = Line(StartPoint=list_item.Item6, EndPoint=list_item.Item11)
line_25 = Line(StartPoint=list_item.Item10, EndPoint=list_item.Item11)
line_26 = Line(StartPoint=list_item.Item5, EndPoint=list_item.Item9)
line_27 = Line(StartPoint=list_item.Item, EndPoint=list_item.Item4)
line_28 = Line(StartPoint=list_item.Item3, EndPoint=list_item.Item2)
line_29 = Line(StartPoint=list_item.Item3, EndPoint=list_item.Item7)
line_30 = Line(StartPoint=list_item.Item3, EndPoint=list_item.Item4)
cables = Line([line, line_2, line_9, line_22, line_27, line_30, line_29, line_28, line_16, line_17, line_23, line_24, line_18, line_19, line_25, line_20, line_10, line_26, line_11, line_12, line_13, line_14, line_15, line_21])
struts = Line([line_6, line_7, line_3, line_8, line_4, line_5])
geometry = Curve([struts, cables])
geometry_2 = ClusterOutput(geometry)

# ==== cluster SphereIsh
unit_z = UnitZ(Factor="50")
mesh_sphere = MeshSphere(Base=PlaneXY(0, 0, 0), Radius="50", UCount=Slider(6, range=0..10), VCount=Slider(8, range=0..10))
move = Move(Geometry=mesh_sphere, Motion=unit_z)  # -> Geometry, Transform
mesh_edges = MeshEdges(Mesh=move.Geometry)  # -> NakedEdges, InteriorEdges, NonManifoldEdges
geometry = ClusterOutput(mesh_edges.InteriorEdges)
